# Grasshopper definition bobbypin.gh (Grasshopper 1.0.7)

inside_edge = Slider(5, range=0..5)
offset = Slider(1.543, range=0..4)
unit_z = UnitZ(Factor=inside_edge)
outside_edge = Slider(5, range=0..5)
curve = Curve(<curve referenced from the Rhino model>)
offset_curve = OffsetCurve(Curve=curve, Distance=offset, Plane=PlaneXY(0, 0, 0), Corners=1)
extrude = Extrude(Base=curve, Direction=unit_z)
unit_z_2 = UnitZ(Factor=outside_edge)
extrude_2 = Extrude(Base=offset_curve, Direction=unit_z_2)
group = Group(Objects=[extrude, extrude_2])
