# Grasshopper definition star.gh (Grasshopper 1.0.7)

outer_wall_big_ring = Slider(6, range=0..6)
outer_ring_thickness = Slider(4, range=0..6)
outside_height = Slider(6, range=0..6)
curve = Curve(<curve referenced from the Rhino model>)
unit_z = UnitZ(Factor=outer_wall_big_ring)
unit_z_2 = UnitZ(Factor=outside_height)
offset_curve = OffsetCurve(Curve=curve, Distance=outer_ring_thickness, Plane=PlaneXY(0, 0, 0), Corners=1)
outer_space = Slider(4, range=0..4)
extrude = Extrude(Base=offset_curve, Direction=unit_z_2)
extrude_2 = Extrude(Base=curve, Direction=unit_z)
offset_curve_2 = OffsetCurve(Curve=offset_curve, Distance=outer_space, Plane=PlaneXY(0, 0, 0), Corners=1)
unit_z_3 = UnitZ(Factor=Slider(6, range=-1..6))
group = Group(Objects=[extrude_2, extrude])
thickness = Slider(4, range=0..6)
extrude_3 = Extrude(Base=offset_curve_2, Direction=unit_z_3)
unit_z_4 = UnitZ(Factor=Slider(6, range=-1.001..6))
offset_curve_3 = OffsetCurve(Curve=offset_curve_2, Distance=thickness, Plane=PlaneXY(0, 0, 0), Corners=1)
unit_z_5 = UnitZ(Factor=Slider(6, range=-1..6))
unit_z_6 = UnitZ(Factor=Slider(6, range=0..6))
extrude_4 = Extrude(Base=offset_curve_3, Direction=unit_z_4)
group_2 = Group(Objects=[extrude_3, extrude_4])
thickness_2 = Slider(4, range=0..4)
thickness_3 = Slider(4, range=0..4)
offset_curve_4 = OffsetCurve(Curve=offset_curve_3, Distance=thickness_2, Plane=PlaneXY(0, 0, 0), Corners=1)
extrude_5 = Extrude(Base=offset_curve_4, Direction=unit_z_5)
offset_curve_5 = OffsetCurve(Curve=offset_curve_4, Distance=thickness_3, Plane=PlaneXY(0, 0, 0), Corners=1)
extrude_6 = Extrude(Base=offset_curve_5, Direction=unit_z_6)
group_3 = Group(Objects=[extrude_5, extrude_6])
